# Grasshopper definition random_walker_v001.gh (Grasshopper 1.0.7)

rectangle = Rectangle(Plane=PlaneXY(0, 0, 0), XSize=Slider(10, range=0..10), YSize=Slider(10, range=0..10), Radius=0)  # -> Rectangle, Length
boxrec = BoxRectangle(Rectangle=rectangle.Rectangle, Height=Slider(10, range=0..10))
wires = BrepWireframe(Brep=boxrec, Density=-1)
pop3d = Populate3D(Region=boxrec, Count=Slider(6, range=0..100), Seed=1)
pt = Point(simplify(graft(pop3d)))
number_slider = Slider(1000, range=0..1000)
lng = ListLength(List=flatten(pt))
pline = PolyLine(Vertices=flatten(pt), Closed=False)
neg = Negative(Value=number_slider)
dom = ConstructDomain(DomainStart=number_slider, DomainEnd=neg)
random = Random(Range=dom, Number=lng, Seed=Slider(0, range=0..10))
panel = Panel(random)
number_slider_2 = Slider(4, range=0..20)
neg_2 = Negative(Value=number_slider_2)
dom_2 = ConstructDomain(DomainStart=number_slider_2, DomainEnd=neg_2)
random_2 = Random(Range=dom_2, Number=3, Seed=random)  # -> simplify(Random)
panel_2 = Panel(random_2)
num2pt = NumbersToPoints(Numbers=random_2, Mask=4)
move = Move(Geometry=pt, Motion=simplify(num2pt))  # -> Geometry, Transform
ln = Line(StartPoint=pt, EndPoint=move.Geometry)
vec2pt = Vector2Pt(PointA=pt, PointB=move.Geometry, Unitize=False)  # -> Vector, Length
vdis = VectorDisplay(Anchor=pt, Vector=vec2pt.Vector)
pt_2 = Point(flatten(move.Geometry))
points = PointList(Points=flatten(pt_2), Size=1)
order = PointOrder(Points=flatten(pt_2))
